# Grasshopper definition Rigidity Via Geometry.gh (Grasshopper 1.0.7)
# plug-ins: treesloth01, Pufferfish

# ---- group: Period
side_tangants_gap = Slider(0.07, range=0..1)
side_tangents_placment = Slider(0.76, range=0..1)

center_axis_gap = Slider(0.15, range=0..1)
center_axis_placement = Slider(0.3, range=0..1)

top_tangancy = Slider(0.2, range=0..1)
base = Slider(0.5, range=0..0.5)
cluster = Cluster_2(
    top_tangency=top_tangancy,
    side_tangents_gap=side_tangants_gap,
    side_tangents_placment=side_tangents_placment,
    center_axis_gap=center_axis_gap,
    center_axis_placement=center_axis_placement,
    base=base)  # -> periodic_curve_2, bounding_cell_2
data = Data(cluster.bounding_cell_2)
data_2 = Data(cluster.periodic_curve_2)
bounding_cell = Curve(data)
module = Curve(data_2)

# ----
panel = Panel("333.333")
panel_2 = Panel("500")
control_perodic_crv_num_connection = Slider(0.15, range=0..1)
width = Slider(46.79, range=0..1000)
height = Slider(62, range=0..1000)
division = Division(A=height, B="6")
cluster_2 = Cluster_3(
    edgy_smooth=Toggle(False),
    control_perodic_crv_num_connections=control_perodic_crv_num_connection,
    width=width,
    heigth=division,
    control_perodic_crv_num_picks=Slider(0.15, range=0..1))  # -> periodic_curve_2, bounding_cell_2
data_3 = Data(cluster_2.periodic_curve_2)
bounding_cell_2 = Curve(cluster_2.bounding_cell_2)
module_2 = Curve(data_3)

auxilary_profile_1_relative_placement_ap = Slider(0.1, range=0..1)  # "Auxilary Profile 1 relative Placement (AP1rP)"
auxilary_profile_2_relative_placement_ap = Slider(0.3, range=0..1)  # "Auxilary Profile 2 relative Placement (AP2rP)"

thickness_of_the_key_stone_kst = Slider(20, range=0..200)
relative_parameter_of_the_key_stone_decp = Slider(0.5, range=0..1)  # "relative Parameter of the Key-Stone Decplacement (rPKSD)"
wall_base_thickness_t = Slider(30, range=-10..800)
number_of_infill_layers_nl = Slider(4, range=0..10)
distance_between_the_layers_dl = Slider(2, range=0..10)
wall_length_l = Slider(75, range=0..1000)
number_of_the_periods_np = Slider(7, range=0..10)
_1st_height_of_the_vaults_h1 = Slider(150, range=0..1000)
_2nd_height_of_the_vaults_h2 = Slider(150, range=0..1000)
the_span_s = Slider(150, range=0..1200)

the_extent_of_vertical_extrusion_ve = Slider(25, range=0..2000)
the_number_of_connections_nc = Slider(3, range=3..8)

deviation_dv = Slider(1, range=0..5)
length_of_ribs_advance_a = Slider(15, range=0..100)

# ---- group: periodic and bounding curves
control_perodic_crv_num_connection_2 = Slider(0.27, range=0..1)
control_perodic_crv_num_picks = Slider(0.15, range=0..1)
cluster_3 = Cluster(
    edgy_smooth=Toggle(False),
    control_perodic_crv_num_connections=control_perodic_crv_num_connection_2,
    control_perodic_crv_num_picks=control_perodic_crv_num_picks)  # -> periodic_curve_2, bounding_cell_2
data_4 = Data(cluster_3.periodic_curve_2)
data_5 = Data(cluster_3.bounding_cell_2)
bounding_cell_3 = Curve(data_5)
module_3 = Curve(data_4)

# ----
infill_pattern = InfillPattern(
    C=module_2,
    bounding_cell=bounding_cell_2,
    distance_between_layers=distance_between_the_layers_dl,
    wall_base_thickness=wall_base_thickness_t,
    wall_length=wall_length_l,
    number_of_infill_layers=number_of_infill_layers_nl,
    number_of_the_periods=number_of_the_periods_np)
mod = Modulus(A=number_of_infill_layers_nl, B=2)
group = Group(Objects=flatten(infill_pattern))
brec = BoundingRectangle(Geometry=group, Plane=PlaneXY(0, 0, 0), Axis=0, Slide=0, Union=True)  # -> Bounding, DimensionX, DimensionY

# ----
# Key-Stone pattern
key_stone = KeyStone(infill_pattern=infill_pattern, odd_or_even_nl=mod, thickness_of_the_key_stone=thickness_of_the_key_stone_kst)  # -> crv_9, crv_10

# ----
# Double ribbed
double_ribbed = DoubleRibbed(
    infill_pattern=infill_pattern,
    deviation=deviation_dv,
    number_of_the_periods=number_of_the_periods_np,
    odd_or_even_nl=mod,
    A=length_of_ribs_advance_a)

# ----
# Single Ribbed
single_ribbed = SingleRibbed(
    number_of_periods=number_of_the_periods_np,
    D=infill_pattern,
    odd_or_even_nl=mod,
    length_of_ribs_advance=length_of_ribs_advance_a)

brec_2 = BoundingRectangle(Geometry=flatten(key_stone.crv_9), Plane=PlaneXY(0, 0, 0), Axis=0, Slide=0, Union=True)  # -> Bounding, DimensionX, DimensionY
brec_3 = BoundingRectangle(Geometry=flatten(key_stone.crv_10), Plane=PlaneXY(0, 0, 0), Axis=0, Slide=0, Union=True)  # -> Bounding, DimensionX, DimensionY
group_2 = Group(Objects=flatten(key_stone.crv_9))
group_3 = Group(Objects=flatten(key_stone.crv_10))
graft = GraftTree(Tree=double_ribbed, IncludeEmptyLists=True, IncludeNullItems=True)
graft_2 = GraftTree(Tree=single_ribbed, IncludeEmptyLists=True, IncludeNullItems=True)
crv = Curve(graft)
cluster_4 = Cluster_4(
    infill_pattern=group,
    the_number_of_connections_nc=the_number_of_connections_nc,
    infill_pattern_bounding_rec=brec.Bounding,
    the_extent_of_vertical_extrusion=the_extent_of_vertical_extrusion_ve,
    wall_length=wall_length_l,
    span=the_span_s,
    wall_base_thickness=wall_base_thickness_t,
    _2nd_height_of_the_vaults_h2=_2nd_height_of_the_vaults_h2,
    key_stone_pattern=group_2,
    key_stone_b_rec=brec_2.Bounding,
    relative_parameter_of_the_key_stone_decp=relative_parameter_of_the_key_stone_decp,
    A=thickness_of_the_key_stone_kst,
    _1st_height_of_the_vaults=_1st_height_of_the_vaults_h1,
    number_of_infill_layers=number_of_infill_layers_nl)  # -> C, T, inequality, B, crv_7
pt = Point(cluster_4.C)
pln = Plane(cluster_4.T)
crv_2 = Curve(cluster_4.crv_7)
brep = Brep(cluster_4.B)
cluster_5 = Cluster_5(
    threshold_curves=crv_2,
    auxilary_profile_2_relative_placement=auxilary_profile_2_relative_placement_ap,
    auxilary_profile_1_relative_placement=auxilary_profile_1_relative_placement_ap)  # -> L_2, relay_2, L_3, relay, L, L_4
crv_3 = Curve(cluster_5.L_2)
crv_4 = Curve(cluster_5.relay_2)
crv_5 = Curve(cluster_5.L_3)
crv_6 = Curve(cluster_5.relay)
crv_7 = Curve(cluster_5.L)
crv_8 = Curve(cluster_5.L_4)
shift = ShiftPaths(Data=crv_3, Offset=-1)
shift_2 = ShiftPaths(Data=crv_5, Offset=-1)
shift_3 = ShiftPaths(Data=crv_7, Offset=-1)
shift_4 = ShiftPaths(Data=crv_8, Offset=-1)
flip = FlipMatrix(Data=shift)
flip_2 = FlipMatrix(Data=shift_2)
flip_3 = FlipMatrix(Data=shift_3)
flip_4 = FlipMatrix(Data=shift_4)
crv_9 = Curve(flip)
crv_10 = Curve(flip_3)
crv_11 = Curve(flip_4)
crv_12 = Curve(flip_2)

relative_size_of_the_connection_rsc = Slider(0.61, range=0.5..0.99)
height_of_the_connection_frame_hcf = Slider(40, range=0..100)

relative_center_axis_of_r_key_stone_rr = Slider(0.5, range=0..1)
_1st_height_of_r_vault_h1r = Slider(150, range=0..1000)
span_of_r_vault_sr = Slider(100, range=0..100)
_2nd_height_of_r_vault_h2r = Slider(150, range=0..1000)

relative_center_axis_of_l_key_stone_rl = Slider(0.5, range=0..1)
_1st_height_of_l_vault_h1l = Slider(100, range=0..1000)
_2nd_height_of_l_vault_h2l = Slider(100, range=0..1000)
span_of_l_vault_sl = Slider(75, range=0..100)

# ----
# Phase1: Vault
phase1_vault = Phase1Vault(
    double_ribbed=crv,
    key_stone_pattern=key_stone.crv_10,
    key_stone_b_rec=brec_3.Bounding,
    the_extent_of_vertical_extrusion=the_extent_of_vertical_extrusion_ve,
    span=the_span_s,
    _1st_height_of_the_vaults=_1st_height_of_the_vaults_h1,
    wall_length=wall_length_l,
    thickness_of_the_key_stone_kst=thickness_of_the_key_stone_kst,
    _2nd_height_of_the_vaults=_2nd_height_of_the_vaults_h2)

# ----
# Phase 2 Class 1
phase_1_class_1 = Phase1Class1(
    infill_pattern=infill_pattern,
    height_of_the_connection_frame=height_of_the_connection_frame_hcf,
    span_of_l_vault=span_of_l_vault_sl,
    single_ribbed=graft_2,
    relative_size_of_the_connection=relative_size_of_the_connection_rsc,
    wall_length=wall_length_l,
    double_ribbed=crv,
    span_of_r_vault=span_of_r_vault_sr,
    _1st_height_of_r_vault=_1st_height_of_r_vault_h1r,
    relative_center_axis_of_r_key_stone=relative_center_axis_of_r_key_stone_rr,
    key_stone_pattern=key_stone.crv_10,
    _2nd_height_of_r_vault=_2nd_height_of_r_vault_h2r,
    _1st_height_of_l_vault=_1st_height_of_l_vault_h1l,
    key_stone_pattern_bounding_rectangle=brec_3.Bounding,
    thickness_of_the_key_stone=thickness_of_the_key_stone_kst,
    relative_center_axis_of_l_key_stone_rl=relative_center_axis_of_l_key_stone_rl,
    _2nd_height_of_l_vault=_2nd_height_of_l_vault_h2l)

brep_2 = Brep(phase_1_class_1)

brep_3 = Brep(phase1_vault)

innermost_vector_amplitude_iva = Slider(5, range=0..100)
general_amplitude_ga = Slider(5, range=0..100)
odd_outermost_vector_amplitude_oova = Slider(7, range=0..10)
even_outermost_vector_amplitude_eova = Slider(4, range=0..100)

innermost_vector_amplitude_iva_2 = Slider(0, range=0..100)
general_amplitude_ga_2 = Slider(5, range=0..100)
odd_outermost_vector_amplitude_oova_2 = Slider(7, range=0..10)
even_outermost_vector_amplitude_eova_2 = Slider(10, range=0..100)

top_column_clipping_rectangle_width_scal = Slider(0.75, range=0..10)  # "Top column clipping rectangle Width Scaler (TWS)"
base_column_curve_width_scaler_bws = Slider(0.5, range=0..1)
relative_parameter_of_the_mirror_plane_r = Slider(0.35, range=0..1)  # "Relative parameter of the mirror plane (rMP)"
angle_of_rotation_α = Slider(25, range=0..180)
top_bottom_tween_curve_width_scaler_tbtc = Slider(0.8, range=0..1)  # "Top-Bottom Tween Curve Width Scaler (TBTCWS)"
top_bottom_tween_curve_factor_tbtcf = Slider(0.5, range=0..1)
mid_column_height_mch = Slider(11, range=0..21)

general_amplitude_ga_3 = Slider(4.1, range=0..100)
odd_outermost_vector_amplitude_oova_3 = Slider(4, range=0..10)
innermost_vector_amplitude_iva_3 = Slider(13, range=0..100)
even_outermost_vector_amplitude_eova_3 = Slider(11, range=0..130)

innermost_vector_amplitude_iva_4 = Slider(8, range=0..100)
general_amplitude_ga_4 = Slider(4.6, range=0..100)
odd_outermost_vector_amplitude_oova_4 = Slider(10, range=0..10)
even_outermost_vector_amplitude_eova_4 = Slider(6, range=0..100)

# ----
# Phase 2 Class 2
phase_2_class_2 = Phase2Class2(
    the_vault_of_phase_1=brep_3,
    angle_of_rotation=angle_of_rotation_α,
    top_column_clipping_rectangle_width_scal=top_column_clipping_rectangle_width_scal,
    relative_parameter_of_the_mirror_plane=relative_parameter_of_the_mirror_plane_r,
    top_bottom_tween_curve_factor=top_bottom_tween_curve_factor_tbtcf,
    mid_column_height=mid_column_height_mch,
    base_column_curve_width_scaler=base_column_curve_width_scaler_bws,
    top_bottom_tween_curve_width_scaler=top_bottom_tween_curve_width_scaler_tbtc)

cluster_6 = Cluster_6(
    innermost_vector_amplitude_iva=innermost_vector_amplitude_iva_2,
    G=mod,
    C=crv_9,
    general_amplitude=general_amplitude_ga_2,
    odd_outermost_vector_amplitude_oova=odd_outermost_vector_amplitude_oova_2,
    centroid=pt,
    even_outermost_vector_amplitude_eova=even_outermost_vector_amplitude_eova_2)
cluster_7 = Cluster_6(
    innermost_vector_amplitude_iva=innermost_vector_amplitude_iva,
    G=mod,
    C=crv_12,
    general_amplitude=general_amplitude_ga,
    odd_outermost_vector_amplitude_oova=odd_outermost_vector_amplitude_oova,
    centroid=pt,
    even_outermost_vector_amplitude_eova=even_outermost_vector_amplitude_eova)
cluster_8 = Cluster_6(
    innermost_vector_amplitude_iva=innermost_vector_amplitude_iva_4,
    G=mod,
    C=crv_10,
    general_amplitude=general_amplitude_ga_4,
    odd_outermost_vector_amplitude_oova=odd_outermost_vector_amplitude_oova_4,
    centroid=pt,
    even_outermost_vector_amplitude_eova=even_outermost_vector_amplitude_eova_4)
cluster_9 = Cluster_6(
    innermost_vector_amplitude_iva=innermost_vector_amplitude_iva_3,
    G=mod,
    C=crv_11,
    general_amplitude=general_amplitude_ga_3,
    odd_outermost_vector_amplitude_oova=odd_outermost_vector_amplitude_oova_3,
    centroid=pt,
    even_outermost_vector_amplitude_eova=even_outermost_vector_amplitude_eova_3)
crv_13 = Curve(cluster_7)
crv_14 = Curve(cluster_8)
crv_15 = Curve(cluster_9)
crv_16 = Curve(cluster_6)
dome_rise_dr = Slider(10, range=0..10)
project = Project(Geometry=crv_15, Plane=PlaneXY(0, 0, 0))  # -> Geometry, Transform
merge = Merge(Data1=crv_15, Data2=project.Geometry)

brep_4 = Brep(phase_2_class_2)

filter = StreamFilter(Gate=cluster_4.inequality, Stream1=merge)
loft = Loft(Curves=filter, Options={Adjust=False, Closed=False, LoftEnds=0, LoftSimp=0, LoftType=0, Rebuild=10, Refit=0.01})
srf = Surface(loft)

# ----
# Dome Riser
dome_riser = DomeRiser(C=crv_16, d1=crv_8, d2=crv_3, dome_rise=dome_rise_dr)

path_mapper = PathMapper(dome_riser, source="{A;B}", target="{B;A}")
path_mapper_2 = PathMapper(crv_13, source="{A;B}", target="{B;A}")
path_mapper_3 = PathMapper(crv_14, source="{A;B}", target="{B;A}")
path_mapper_4 = PathMapper(crv_15, source="{A;B}", target="{B;A}")
path_mapper_5 = PathMapper(srf, source="{A;B}", target="{B;A}")
crv_17 = Curve(path_mapper)
crv_18 = Curve(path_mapper_2)
crv_19 = Curve(path_mapper_3)
crv_20 = Curve(path_mapper_4)
srf_2 = Surface(path_mapper_5)
midpt = CurveMiddle(Curve=crv_17)
midpt_2 = CurveMiddle(Curve=crv_18)
midpt_3 = CurveMiddle(Curve=crv_19)
midpt_4 = CurveMiddle(Curve=crv_20)
merge_2 = Merge(Data1=midpt_4, Data2=midpt_3, Data3=midpt_2, Data4=midpt)
intcrv = Interpolate(Vertices=merge_2, Degree=3, Periodic=False, KnotStyle=1)  # -> Curve, Length, Domain
merge_3 = Merge(Data1=simplify(crv_4), Data2=intcrv.Curve, Data3=simplify(crv_6))
merge_4 = Merge(Data1=crv_20, Data2=crv_19, Data3=crv_18, Data4=crv_17)
netsurf = NetworkSurface(CurvesU=merge_4, CurvesV=merge_3, Continuity=3)  # -> simplify(Surface)
merge_5 = Merge(Data1=netsurf, Data2=srf_2)
join = BrepJoin(Breps=merge_5)  # -> Breps, Closed

brep_5 = Brep(join.Breps)

# ==== cluster Cluster
control_perodic_crv_num_connections = ClusterInput()
control_perodic_crv_num_picks = ClusterInput()
division = Division(A=Slider(500, range=0..1000), B="6")
control_perodic_crv_num_connections_2 = Number(control_perodic_crv_num_connections)
rectangle = Rectangle(Plane=PlaneXY(0, 0, 0), XSize="333.333", YSize=division, Radius=0)  # -> Rectangle, Length
control_perodic_crv_num_picks_2 = Number(control_perodic_crv_num_picks)
long = LongestList(ListA=rectangle.Rectangle, ListB=control_perodic_crv_num_connections_2, PaddingMode=2)  # -> ListA, ListB
explode = Explode(Curve=long.ListA, Recursive=True)  # -> Segments, Vertices
item = ListItem(List=explode.Segments, Index=0, Wrap=True)  # -> Item, Item1, Item2
expression = Expression(x=long.ListB, Expression="1-x")
expression_2 = Expression(x=control_perodic_crv_num_picks_2, Expression="0.5+x")
expression_3 = Expression(x=control_perodic_crv_num_picks_2, Expression="0.5-x")
flip = FlipCurve(Curve=item.Item2)  # -> Curve, Flag
long_2 = LongestList(ListA="0", ListB=control_perodic_crv_num_connections_2, ListC=expression, ListD="1", PaddingMode=2)  # -> ListA, ListB, ListC, ListD
long_3 = LongestList(ListA=expression_2, ListB=".5", ListC=expression_3, PaddingMode=2)  # -> ListA, ListB, ListC
merge = Merge(Data1=graft(long_2.ListA), Data2=graft(long_2.ListB), Data3=graft(long_2.ListC), Data4=graft(long_2.ListD))
merge_2 = Merge(Data1=graft(long_3.ListC), Data2=graft(long_3.ListB), Data3=graft(long_3.ListA))

# ---- group: bottom
eval = EvaluateCurve(Curve=reparameterize(item.Item), Parameter=merge)  # -> Point, Tangent, Angle

# ---- group: top
eval_2 = EvaluateCurve(Curve=reparameterize(flip.Curve), Parameter=merge_2)  # -> Point, Tangent, Angle

# ----
panel = Panel(merge_2)
item_2 = ListItem(List=eval.Point, Index=0, Wrap=True)  # -> Item, Item1, Item2, Item3
edgy_smooth = ClusterInput()
merge_3 = Merge(Data1=item_2.Item, Data2=item_2.Item1, Data3=eval_2.Point, Data4=item_2.Item2, Data5=item_2.Item3)
nurbs = NurbsCurve(Vertices=merge_3, Degree=3, Periodic=False)  # -> Curve, Length, Domain
pline = PolyLine(Vertices=merge_3, Closed=False)
edgy_smooth_2 = Boolean(edgy_smooth)
bounding_cell = Curve(rectangle.Rectangle)
filter = StreamFilter(Gate=edgy_smooth_2, Stream0=nurbs.Curve, Stream1=pline)
periodic_curve = Curve(filter)
bounding_cell_2 = ClusterOutput(bounding_cell)
periodic_curve_2 = ClusterOutput(periodic_curve)

# ==== cluster Cluster_2
base = ClusterInput()
top_tangency = ClusterInput()
side_tangents_gap = ClusterInput()
side_tangents_placment = ClusterInput()
center_axis_gap = ClusterInput()
center_axis_placement = ClusterInput()
top_tangency_2 = Number(top_tangency)
side_tangents_gap_2 = Number(side_tangents_gap)
side_tangents_placment_2 = Number(side_tangents_placment)
center_axis_placement_2 = Number(center_axis_placement)
base_2 = Number(base)
center_axis_gap_2 = Number(center_axis_gap)
rectangle = Rectangle(Plane=PlaneXY(0, 0, 0), XSize=Slider(150, range=0..1000), YSize=Slider(350, range=0..1000), Radius=0)  # -> Rectangle, Length
explode = Explode(Curve=rectangle.Rectangle, Recursive=True)  # -> Segments, Vertices
expression = Expression(x=top_tangency_2, Expression="0.5+x")
expression_2 = Expression(x=top_tangency_2, Expression="0.5-x")
expression_3 = Expression(x=side_tangents_gap_2, y=side_tangents_placment_2, Expression="y+x")
expression_4 = Expression(x=side_tangents_gap_2, y=side_tangents_placment_2, Expression="y-x")
expression_5 = Expression(x=center_axis_gap_2, y=center_axis_placement_2, Expression="y+x")
expression_6 = Expression(x=center_axis_gap_2, y=center_axis_placement_2, Expression="y-x")
item = ListItem(List=explode.Segments, Index=0, Wrap=True)  # -> Item, Item1, Item2, Item3
long = LongestList(ListA=expression_3, ListB=side_tangents_placment_2, ListC=expression_4, PaddingMode=2)  # -> ListA, ListB, ListC
long_2 = LongestList(ListA=expression_5, ListB=center_axis_placement_2, ListC=expression_6, PaddingMode=2)  # -> ListA, ListB, ListC
long_3 = LongestList(ListA=expression, ListB=".5", ListC=expression_2, PaddingMode=2)  # -> ListA, ListB, ListC
merge = Merge(Data1=graft(long_3.ListC), Data2=graft(long_3.ListB), Data3=graft(long_3.ListA))
merge_2 = Merge(Data1=graft(long.ListC), Data2=graft(long.ListB), Data3=graft(long.ListA))
merge_3 = Merge(Data1=graft(long_2.ListC), Data2=graft(long_2.ListB), Data3=graft(long_2.ListA))
subtraction = Subtraction(A=".5", B=base_2)
addition = Addition(A=".5", B=base_2)
midpt = CurveMiddle(Curve=item.Item)
midpt_2 = CurveMiddle(Curve=item.Item2)
data = Data(item.Item3)
merge_4 = Merge(Data1="0", Data2=subtraction, Data3=addition, Data4="1")
flip = FlipCurve(Curve=item.Item2)  # -> Curve, Flag
ln = Line(StartPoint=midpt, EndPoint=midpt_2)
flip_2 = FlipCurve(Curve=data)  # -> Curve, Flag
eval = EvaluateCurve(Curve=reparameterize(item.Item), Parameter=merge_4)  # -> Point, Tangent, Angle
item_2 = ListItem(List=eval.Point, Index=0, Wrap=True)  # -> Item, Item1, Item2, Item3
eval_2 = EvaluateCurve(Curve=reparameterize(ln), Parameter=merge_3)  # -> Point, Tangent, Angle
rev = ReverseList(List=eval_2.Point)
eval_3 = EvaluateCurve(Curve=reparameterize(flip_2.Curve), Parameter=merge_2)  # -> Point, Tangent, Angle
eval_4 = EvaluateCurve(Curve=reparameterize(flip.Curve), Parameter=merge)  # -> Point, Tangent, Angle
eval_5 = EvaluateCurve(Curve=reparameterize(item.Item1), Parameter=merge_2)  # -> reverse(Point), Tangent, Angle
merge_5 = Merge(Data1=item_2.Item, Data2=item_2.Item1)
merge_6 = Merge(Data1=item_2.Item2, Data2=item_2.Item3)
merge_7 = Merge(Data1=merge_5, Data2=eval_2.Point, Data3=eval_3.Point, Data4=eval_4.Point, Data5=eval_5.Point, Data6=rev, Data7=merge_6)
nurbs = NurbsCurve(Vertices=merge_7, Degree=3, Periodic=False)  # -> Curve, Length, Domain

periodic_curve = Curve(nurbs.Curve)
bounding_cell = Curve(rectangle.Rectangle)

periodic_curve_2 = ClusterOutput(periodic_curve)
bounding_cell_2 = ClusterOutput(bounding_cell)

# ==== cluster Cluster_3
control_perodic_crv_num_connections = ClusterInput()
heigth = ClusterInput()
width = ClusterInput()

# ---- group: Controll bounding box
panel = Panel("333.333")
division = Division(A=Slider(500, range=0..1000), B="6")
rectangle = Rectangle(Plane=PlaneXY(0, 0, 0), XSize=width, YSize=heigth, Radius=0)  # -> Rectangle, Length

# ----
control_perodic_crv_num_picks = ClusterInput()
number_slider = Slider(0.43, range=0..1)
number_slider_2 = Slider(0.19, range=0..1)
# Start of the tanget line
control_perodic_crv_num_connections_2 = Number(control_perodic_crv_num_connections)
# end of the tanget line
control_perodic_crv_num_picks_2 = Number(control_perodic_crv_num_picks)
# what does longest list do ?
long = LongestList(ListA=rectangle.Rectangle, ListB=control_perodic_crv_num_connections_2, PaddingMode=2)  # -> ListA, ListB
explode = Explode(Curve=long.ListA, Recursive=True)  # -> Segments, Vertices
item = ListItem(List=explode.Segments, Index=0, Wrap=True)  # -> Item, Item1, Item2
expression = Expression(x=long.ListB, Expression="1-x")
expression_2 = Expression(x=control_perodic_crv_num_picks_2, Expression="0.5+x")
expression_3 = Expression(x=control_perodic_crv_num_picks_2, Expression="0.5-x")
flip = FlipCurve(Curve=item.Item2)  # -> Curve, Flag
long_2 = LongestList(ListA="0", ListB=control_perodic_crv_num_connections_2, ListC=expression, ListD="1", PaddingMode=2)  # -> ListA, ListB, ListC, ListD
long_3 = LongestList(ListA=expression_2, ListB=".5", ListC=expression_3, PaddingMode=2)  # -> ListA, ListB, ListC
merge = Merge(Data1=graft(long_2.ListA), Data2=graft(long_2.ListB), Data3=graft(long_2.ListC), Data4=graft(long_2.ListD))
merge_2 = Merge(Data1=graft(long_3.ListC), Data2=graft(long_3.ListB), Data3=graft(long_3.ListA))

# ---- group: bottom
eval = EvaluateCurve(Curve=reparameterize(item.Item), Parameter=merge)  # -> Point, Tangent, Angle

# ---- group: top
eval_2 = EvaluateCurve(Curve=reparameterize(flip.Curve), Parameter=merge_2)  # -> Point, Tangent, Angle

# ----
panel_2 = Panel(merge_2)
item_2 = ListItem(List=eval.Point, Index=0, Wrap=True)  # -> Item, Item1, Item2, Item3
edgy_smooth = ClusterInput()
merge_3 = Merge(Data1=item_2.Item, Data2=item_2.Item1, Data3=eval_2.Point, Data4=item_2.Item2, Data5=item_2.Item3)
nurbs = NurbsCurve(Vertices=merge_3, Degree=3, Periodic=False)  # -> Curve, Length, Domain
pline = PolyLine(Vertices=merge_3, Closed=False)
edgy_smooth_2 = Boolean(edgy_smooth)
bounding_cell = Curve(rectangle.Rectangle)
filter = StreamFilter(Gate=edgy_smooth_2, Stream0=nurbs.Curve, Stream1=pline)
periodic_curve = Curve(filter)
bounding_cell_2 = ClusterOutput(bounding_cell)
periodic_curve_2 = ClusterOutput(periodic_curve)

# ==== cluster InfillPattern
wall_base_thickness = ClusterInput()
number_of_infill_layers = ClusterInput()
number_of_the_periods = ClusterInput()
wall_length = ClusterInput()
bounding_cell = ClusterInput()
distance_between_layers = ClusterInput()
C = ClusterInput()

# ----
# Base infill
division = Division(A=wall_base_thickness, B=2)
neg = Negative(Value=division)
dom = ConstructDomain(DomainStart=neg, DomainEnd=division)
dom²num = ConstructDomain²(UMin="0", UMax="1", VMin="0", VMax="1")
rectangle = Rectangle(Plane=PlaneXY(0, 0, 0), XSize=dom, YSize=wall_length, Radius=0)  # -> Rectangle, Length
divide = DivideDomain²(Domain=dom²num, UCount=number_of_infill_layers, VCount=number_of_the_periods)
debox = DeconstructBox(Box=bounding_cell)  # -> Plane, X, Y, Z
subsrf = Isotrim(Surface=reparameterize(rectangle.Rectangle), Domain=divide)
partition = PartitionList(List=subsrf, Size=number_of_the_periods)
multiplication = Multiplication(A=distance_between_layers, B=2)
num = Number(debox.Y)
addition = Addition(A=num, B=multiplication)
rectangle_2 = Rectangle(Plane=PlaneXY(0, 0, 0), XSize=debox.X, YSize=addition, Radius=0)  # -> Rectangle, Length
tstat = TreeStatistics(Tree=partition)  # -> Paths, Length, Count
area = Area(Geometry=rectangle_2.Rectangle)  # -> Area, Centroid
area_2 = Area(Geometry=bounding_cell)  # -> Area, Centroid
dispatch = Dispatch(List=tstat.Paths, DispatchPattern=[True, False])  # -> ListA, ListB
move2pt = MoveToPoint(Geometry=rectangle_2.Rectangle, PointA=area.Centroid, PointB=area_2.Centroid)  # -> Moved, Vector, Transform
branch = TreeBranch(Tree=partition, Path=dispatch.ListB, MaintainPaths=True)
branch_2 = TreeBranch(Tree=partition, Path=dispatch.ListA, MaintainPaths=True)
revsrf = ReverseSurfaceDirection(Surface=move2pt.Moved, ReverseOption=Slider(3, range=0..3))
revsrf_2 = ReverseSurfaceDirection(Surface=branch_2, ReverseOption=Slider(1, range=0..3))
merge = Merge(Data1=revsrf_2, Data2=branch)
map_srf = MapToSurface(Curve=C, Source=revsrf, Target=merge)
rev = ReverseList(List=map_srf)
graft = GraftTree(Tree=rev, IncludeEmptyLists=True, IncludeNullItems=True)
crv = Curve(simplify(graft))
prepend_element = PrependElement(Data=crv, Index="0")
crv_2 = Curve(prepend_element)

crv_3 = ClusterOutput(crv_2)

# ==== cluster SingleRibbed
D = ClusterInput()
number_of_periods = ClusterInput()
length_of_ribs_advance = ClusterInput()
odd_or_even_nl = ClusterInput()

# ----
# Single ribbed
shift = ShiftPaths(Data=D, Offset=-1)
tstat = TreeStatistics(Tree=shift)  # -> Paths, Length, Count
panel = Panel("0")
item = ListItem(List=tstat.Paths, Index="-1", Wrap=True)
cull_i = CullIndex(List=tstat.Paths, Indices="-1", Wrap=True)
branch = TreeBranch(Tree=shift, Path=item, MaintainPaths=True)
branch_2 = TreeBranch(Tree=shift, Path=cull_i, MaintainPaths=True)
integer_division = IntegerDivision(A=number_of_periods, B=2)
mod = Modulus(A=number_of_periods, B=2)
addition = Addition(A=integer_division, B=mod)
subtraction = Subtraction(A=addition, B=1)
item_2 = ListItem(List=branch, Index=subtraction, Wrap=True)
cull_i_2 = CullIndex(List=branch, Indices=subtraction, Wrap=True)
crv = Curve(item_2)
crv_2 = Curve(cull_i_2)
cp = ControlPoints(Curve=crv)  # -> Points, Weights, Knots
match = MatchTree(Tree=crv_2, Guide=crv)
item_3 = ListItem(List=cp.Points, Index=0, Wrap=True)  # -> Item, Item1, Item2, Item3, Item4, Item5, Item6, Item7
multiplication = Multiplication(A=length_of_ribs_advance, B=2)
pt = Point(item_3.Item2)
pt_2 = Point(item_3.Item3)
pt_3 = Point(item_3.Item4)
filter = StreamFilter(Gate=odd_or_even_nl, Stream0=length_of_ribs_advance, Stream1=multiplication)
merge = Merge(Data1=pt, Data2=pt_2, Data3=pt_3)
X = UnitX(Factor=filter)
move = Move(Geometry=merge, Motion=X)  # -> Geometry, Transform
merge_2 = Merge(Data1=item_3.Item, Data2=item_3.Item1, Data3=move.Geometry, Data4=item_3.Item5, Data5=item_3.Item6)
nurbs = NurbsCurve(Vertices=merge_2, Degree=3, Periodic=False)  # -> Curve, Length, Domain
shift_2 = ShiftPaths(Data=nurbs.Curve, Offset=-1)
merge_3 = Merge(Data1=shift_2, Data2=match)
midpt = CurveMiddle(Curve=merge_3)
pdecon = Deconstruct(Point=midpt)  # -> XComponent, YComponent, ZComponent
sort = SortList(Keys=pdecon.YComponent, ValuesA=merge_3)  # -> Keys, ValuesA
merge_4 = Merge(Data1=branch_2, Data2=sort.ValuesA)
crv_3 = Curve(merge_4)
midpt_2 = CurveMiddle(Curve=crv_3)
pdecon_2 = Deconstruct(Point=midpt_2)  # -> XComponent, YComponent, ZComponent
sort_2 = SortList(Keys=pdecon_2.YComponent, ValuesA=crv_3)  # -> Keys, reverse(ValuesA)
crv_4 = Curve(sort_2.ValuesA)

crv_5 = ClusterOutput(crv_4)

# ==== cluster KeyStone
infill_pattern = ClusterInput()
odd_or_even_nl = ClusterInput()
thickness_of_the_key_stone = ClusterInput()

# ----
# Key-stone
shift = ShiftPaths(Data=infill_pattern, Offset=-1)
tstat = TreeStatistics(Tree=shift)  # -> Paths, Length, Count
lastdex = LastIndex(List=tstat.Paths)
cull_i = CullIndex(List=tstat.Paths, Indices="0", Wrap=True)
cull_i_2 = CullIndex(List=tstat.Paths, Indices=lastdex, Wrap=True)
item = ListItem(List=tstat.Paths, Index="0", Wrap=True)
item_2 = ListItem(List=tstat.Paths, Index=lastdex, Wrap=True)
branch = TreeBranch(Tree=shift, Path=item, MaintainPaths=True)
branch_2 = TreeBranch(Tree=shift, Path=cull_i, MaintainPaths=True)
branch_3 = TreeBranch(Tree=shift, Path=item_2, MaintainPaths=True)
branch_4 = TreeBranch(Tree=shift, Path=cull_i_2, MaintainPaths=True)
crv = Curve(branch_3)
crv_2 = Curve(branch)
cp = ControlPoints(Curve=crv)  # -> Points, Weights, Knots
cp_2 = ControlPoints(Curve=crv_2)  # -> Points, Weights, Knots
item_3 = ListItem(List=cp.Points, Index=0, Wrap=True)  # -> Item, Item1, Item2
item_4 = ListItem(List=cp_2.Points, Index=0, Wrap=True)
pt = Point(item_3.Item2)
pt_2 = Point(item_3.Item)
pt_3 = Point(item_4)
filter = StreamFilter(Gate=odd_or_even_nl, Stream0=pt_2, Stream1=pt)
yz = YZPlane(Origin=pt_3)
yz_2 = YZPlane(Origin=filter)
project = Project(Geometry=cp_2.Points, Plane=yz)  # -> Geometry, Transform
project_2 = Project(Geometry=cp.Points, Plane=yz_2)  # -> Geometry, Transform
nurbs = NurbsCurve(Vertices=project.Geometry, Degree=3, Periodic=False)  # -> Curve, Length, Domain
nurbs_2 = NurbsCurve(Vertices=project_2.Geometry, Degree=3, Periodic=False)  # -> Curve, Length, Domain
shift_2 = ShiftPaths(Data=nurbs.Curve, Offset=-1)
shift_3 = ShiftPaths(Data=nurbs_2.Curve, Offset=-1)
crv_3 = Curve(shift_2)
crv_4 = Curve(shift_3)
merge = Merge(Data1=crv_3, Data2=branch_2)
merge_2 = Merge(Data1=crv_4, Data2=branch_4)
graft = GraftTree(Tree=merge, IncludeEmptyLists=True, IncludeNullItems=True)
graft_2 = GraftTree(Tree=merge_2, IncludeEmptyLists=True, IncludeNullItems=True)
crv_5 = Curve(graft)
crv_6 = Curve(graft_2)
brec = BoundingRectangle(Geometry=flatten(crv_6), Plane=PlaneXY(0, 0, 0), Axis=0, Slide=0, Union=True)  # -> Bounding, DimensionX, DimensionY
brec_2 = BoundingRectangle(Geometry=flatten(crv_5), Plane=PlaneXY(0, 0, 0), Axis=0, Slide=0, Union=True)  # -> Bounding, DimensionX, DimensionY
area = Area(Geometry=brec_2.Bounding)  # -> Area, Centroid
division = Division(A=thickness_of_the_key_stone, B=brec_2.DimensionX)
area_2 = Area(Geometry=brec.Bounding)  # -> Area, Centroid
division_2 = Division(A=thickness_of_the_key_stone, B=brec.DimensionX)
scale_nu = ScaleNU(Geometry=brec_2.Bounding, Plane=area.Centroid, ScaleX=division, ScaleY=1, ScaleZ=1)  # -> Geometry, Transform
scale_nu_2 = ScaleNU(Geometry=brec.Bounding, Plane=area_2.Centroid, ScaleX=division_2, ScaleY=1, ScaleZ=1)  # -> Geometry, Transform
map_srf = MapToSurface(Curve=crv_6, Source=brec.Bounding, Target=scale_nu_2.Geometry)
map_srf_2 = MapToSurface(Curve=crv_5, Source=brec_2.Bounding, Target=scale_nu.Geometry)
crv_7 = Curve(map_srf_2)
crv_8 = Curve(map_srf)

crv_9 = ClusterOutput(crv_7)
crv_10 = ClusterOutput(crv_8)

# ==== cluster DoubleRibbed
infill_pattern = ClusterInput()
number_of_the_periods = ClusterInput()  # Number of the Periods
deviation = ClusterInput()
odd_or_even_nl = ClusterInput()
A = ClusterInput()

# ----
# Double ribbed
shift = ShiftPaths(Data=infill_pattern, Offset=-1)
tstat = TreeStatistics(Tree=shift)  # -> Paths, Length, Count
item = ListItem(List=tstat.Paths, Index="-1", Wrap=True)
cull_i = CullIndex(List=tstat.Paths, Indices="-1", Wrap=True)
branch = TreeBranch(Tree=shift, Path=cull_i, MaintainPaths=True)
mod = Modulus(A=number_of_the_periods, B=2)
branch_2 = TreeBranch(Tree=shift, Path=item, MaintainPaths=True)
integer_division = IntegerDivision(A=number_of_the_periods, B=2)
addition = Addition(A=integer_division, B=mod)
subtraction = Subtraction(A=addition, B=1)
subtraction_2 = Subtraction(A=subtraction, B=deviation)
addition_2 = Addition(A=subtraction, B=deviation)
merge = Merge(Data1=subtraction_2, Data2=addition_2)
cull_i_2 = CullIndex(List=branch_2, Indices=merge, Wrap=True)
item_2 = ListItem(List=branch_2, Index=merge, Wrap=True)
crv = Curve(cull_i_2)
crv_2 = Curve(item_2)
cp = ControlPoints(Curve=crv_2)  # -> Points, Weights, Knots
match = MatchTree(Tree=crv, Guide=crv_2)
item_3 = ListItem(List=cp.Points, Index=0, Wrap=True)  # -> Item, Item1, Item2, Item3, Item4, Item5, Item6, Item7
multiplication = Multiplication(A=A, B=2)
filter = StreamFilter(Gate=odd_or_even_nl, Stream0=A, Stream1=multiplication)
pt = Point(item_3.Item2)
pt_2 = Point(item_3.Item4)
pt_3 = Point(item_3.Item3)
merge_2 = Merge(Data1=pt, Data2=pt_3, Data3=pt_2)
X = UnitX(Factor=filter)
move = Move(Geometry=merge_2, Motion=X)  # -> Geometry, Transform
merge_3 = Merge(Data1=item_3.Item, Data2=item_3.Item1, Data3=move.Geometry, Data4=item_3.Item5, Data5=item_3.Item6)
nurbs = NurbsCurve(Vertices=merge_3, Degree=3, Periodic=False)  # -> Curve, Length, Domain
shift_2 = ShiftPaths(Data=nurbs.Curve, Offset=-1)
merge_4 = Merge(Data1=shift_2, Data2=match)
midpt = CurveMiddle(Curve=merge_4)
pdecon = Deconstruct(Point=midpt)  # -> XComponent, YComponent, ZComponent
sort = SortList(Keys=pdecon.YComponent, ValuesA=merge_4)  # -> Keys, ValuesA
merge_5 = Merge(Data1=branch, Data2=sort.ValuesA)
crv_3 = Curve(merge_5)
midpt_2 = CurveMiddle(Curve=crv_3)
pdecon_2 = Deconstruct(Point=midpt_2)  # -> XComponent, YComponent, ZComponent
sort_2 = SortList(Keys=pdecon_2.YComponent, ValuesA=crv_3)  # -> Keys, reverse(ValuesA)
crv_4 = Curve(sort_2.ValuesA)

crv_5 = ClusterOutput(crv_4)

# ==== cluster Phase1Class1
span_of_l_vault = ClusterInput()
wall_length = ClusterInput()
double_ribbed = ClusterInput()
single_ribbed = ClusterInput()
infill_pattern = ClusterInput()
height_of_the_connection_frame = ClusterInput()
span_of_r_vault = ClusterInput()
relative_center_axis_of_r_key_stone = ClusterInput()
relative_center_axis_of_l_key_stone_rl = ClusterInput()
_2nd_height_of_l_vault = ClusterInput()
_1st_height_of_l_vault = ClusterInput()
_1st_height_of_r_vault = ClusterInput()
_2nd_height_of_r_vault = ClusterInput()
thickness_of_the_key_stone = ClusterInput()
relative_size_of_the_connection = ClusterInput()
key_stone_pattern_bounding_rectangle = ClusterInput()
key_stone_pattern = ClusterInput()

division = Division(A=span_of_l_vault, B=2)
pt = ConstructPoint(XCoordinate=division, YCoordinate=0, ZCoordinate="0")
pt_2 = ConstructPoint(XCoordinate=division, YCoordinate=wall_length, ZCoordinate="0")
ln = Line(StartPoint=pt, EndPoint=pt_2)
midpt = CurveMiddle(Curve=ln)
yz = YZPlane(Origin=midpt)
yz_2 = YZPlane(Origin=midpt)
yz_3 = YZPlane(Origin=midpt)
mirror = Mirror(Geometry=infill_pattern, Plane=yz)  # -> Geometry, Transform
mirror_2 = Mirror(Geometry=single_ribbed, Plane=yz_2)  # -> Geometry, Transform
Z = UnitZ(Factor=height_of_the_connection_frame)
mirror_3 = Mirror(Geometry=double_ribbed, Plane=yz_3)  # -> Geometry, Transform
X = UnitX(Factor=span_of_r_vault)
crv = Curve(mirror.Geometry)
crv_2 = Curve(mirror_2.Geometry)
crv_3 = Curve(mirror_3.Geometry)
move = Move(Geometry=crv, Motion=Z)  # -> Geometry, Transform
move_2 = Move(Geometry=crv_2, Motion=Z)  # -> Geometry, Transform
move_3 = Move(Geometry=crv_3, Motion=X)  # -> Geometry, Transform
brec = BoundingRectangle(Geometry=flatten(move.Geometry), Plane=PlaneXY(0, 0, 0), Axis=0, Slide=0, Union=True)  # -> Bounding, DimensionX, DimensionY
area = Area(Geometry=brec.Bounding)  # -> Area, Centroid
yz_4 = YZPlane(Origin=area.Centroid)
mirror_4 = Mirror(Geometry=move_2.Geometry, Plane=yz_4)  # -> Geometry, Transform
crv_4 = Curve(move_3.Geometry)
crv_5 = Curve(mirror_4.Geometry)
merge = Merge(Data1=crv_5, Data2=crv_4)
merge_2 = Merge(Data1=move_2.Geometry, Data2=double_ribbed)
brec_2 = BoundingRectangle(Geometry=flatten(mirror_4.Geometry), Plane=PlaneXY(0, 0, 0), Axis=0, Slide=0, Union=True)  # -> Bounding, DimensionX, DimensionY
brec_3 = BoundingRectangle(Geometry=flatten(move_2.Geometry), Plane=PlaneXY(0, 0, 0), Axis=0, Slide=0, Union=True)  # -> Bounding, DimensionX, DimensionY
brec_4 = BoundingRectangle(Geometry=flatten(merge), Plane=PlaneXY(0, 0, 0), Axis=0, Slide=0, Union=True)  # -> Bounding, DimensionX, DimensionY
brec_5 = BoundingRectangle(Geometry=flatten(merge_2), Plane=PlaneXY(0, 0, 0), Axis=0, Slide=0, Union=True)  # -> Bounding, DimensionX, DimensionY
vec = VectorXYZ(XComponent=relative_center_axis_of_r_key_stone, YComponent=0, ZComponent=0)  # -> Vector, Length
vec_2 = VectorXYZ(XComponent=relative_center_axis_of_l_key_stone_rl, YComponent=0, ZComponent=0)  # -> Vector, Length
iso = IsoCurve(Surface=reparameterize(brec_4.Bounding), UVPoint=vec.Vector)  # -> UIsocurve, VIsocurve
iso_2 = IsoCurve(Surface=reparameterize(brec_5.Bounding), UVPoint=vec_2.Vector)  # -> UIsocurve, VIsocurve
crv_6 = Curve(iso_2.VIsocurve)
crv_7 = Curve(iso.VIsocurve)
end = EndPoints(Curve=crv_7)  # -> Start, End
end_2 = EndPoints(Curve=crv_6)  # -> Start, End
Z_2 = UnitZ(Factor=_2nd_height_of_r_vault)
Z_3 = UnitZ(Factor=_2nd_height_of_l_vault)
Z_4 = UnitZ(Factor=_1st_height_of_l_vault)
Z_5 = UnitZ(Factor=_1st_height_of_r_vault)
dom²num = ConstructDomain²(UMin=0, UMax=1, VMin="0.50", VMax=1)
dom²num_2 = ConstructDomain²(UMin=0, UMax=1, VMin=0, VMax="0.50")
dom²num_3 = ConstructDomain²(UMin=0, UMax=1, VMin="0.50", VMax=1)
dom²num_4 = ConstructDomain²(UMin=0, UMax=1, VMin=0, VMax="0.50")
move_4 = Move(Geometry=end.End, Motion=Z_2)  # -> Geometry, Transform
move_5 = Move(Geometry=end_2.Start, Motion=Z_4)  # -> Geometry, Transform
move_6 = Move(Geometry=end_2.End, Motion=Z_3)  # -> Geometry, Transform
move_7 = Move(Geometry=end.Start, Motion=Z_5)  # -> Geometry, Transform
subsrf = Isotrim(Surface=reparameterize(brec_3.Bounding), Domain=dom²num)
subsrf_2 = Isotrim(Surface=reparameterize(brec_3.Bounding), Domain=dom²num_2)
subsrf_3 = Isotrim(Surface=reparameterize(brec_2.Bounding), Domain=dom²num_4)
subsrf_4 = Isotrim(Surface=reparameterize(brec_2.Bounding), Domain=dom²num_3)
ln_2 = Line(StartPoint=move_7.Geometry, EndPoint=move_4.Geometry)
ln_3 = Line(StartPoint=move_5.Geometry, EndPoint=move_6.Geometry)
midpt_2 = CurveMiddle(Curve=ln_2)
midpt_3 = CurveMiddle(Curve=ln_3)
X_2 = UnitX(Factor=1)
X_3 = UnitX(Factor=1)
trim = TrimWithRegion(Curve=move_2.Geometry, Region=subsrf)  # -> Inside, Outside
trim_2 = TrimWithRegion(Curve=move_2.Geometry, Region=subsrf_2)  # -> Inside, Outside
trim_3 = TrimWithRegion(Curve=mirror_4.Geometry, Region=subsrf_4)  # -> Inside, Outside
trim_4 = TrimWithRegion(Curve=mirror_4.Geometry, Region=subsrf_3)  # -> Inside, Outside
line = LineSDL(Start=midpt_2, Direction=X_3, Length=1)
line_2 = LineSDL(Start=midpt_3, Direction=X_2, Length=1)
len = Length(Curve=ln)
len_2 = Length(Curve=ln)
pl = ConstructPlane(Origin=midpt_3, XAxis=ln_3, YAxis=line_2)
pl_2 = ConstructPlane(Origin=midpt_2, XAxis=ln_2, YAxis=line)
crv_8 = Curve(trim.Inside)
crv_9 = Curve(trim_2.Inside)
crv_10 = Curve(trim_3.Inside)
crv_11 = Curve(trim_4.Inside)
graft = GraftTree(Tree=crv_8, IncludeEmptyLists=True, IncludeNullItems=True)
graft_2 = GraftTree(Tree=crv_9, IncludeEmptyLists=True, IncludeNullItems=True)
dom = ConstructDomain(DomainStart=expr("-x/2", len), DomainEnd=expr("x/2", len))
dom_2 = ConstructDomain(DomainStart=expr("-x/2", thickness_of_the_key_stone), DomainEnd=expr("x/2", thickness_of_the_key_stone))
dom_3 = ConstructDomain(DomainStart=expr("-x/2", len_2), DomainEnd=expr("x/2", len_2))
dom_4 = ConstructDomain(DomainStart=expr("-x/2", thickness_of_the_key_stone), DomainEnd=expr("x/2", thickness_of_the_key_stone))
graft_3 = GraftTree(Tree=crv_10, IncludeEmptyLists=True, IncludeNullItems=True)
rotax = RotateAxis(Geometry=pl_2, Angle=1.570796327, Axis=ln_2)  # -> Geometry, Transform
graft_4 = GraftTree(Tree=crv_11, IncludeEmptyLists=True, IncludeNullItems=True)
rotax_2 = RotateAxis(Geometry=pl, Angle=1.570796327, Axis=ln_3)  # -> Geometry, Transform
project = Project(Geometry=brec_2.Bounding, Plane=PlaneXY(0, 0, 0))  # -> Geometry, Transform
project_2 = Project(Geometry=brec_3.Bounding, Plane=PlaneXY(0, 0, 0))  # -> Geometry, Transform
subtraction = Subtraction(A="1", B=relative_size_of_the_connection)
subtraction_2 = Subtraction(A="1", B=relative_size_of_the_connection)
dom²num_5 = ConstructDomain²(UMin=0, UMax=1, VMin=0, VMax=subtraction)
dom²num_6 = ConstructDomain²(UMin=0, UMax=1, VMin=relative_size_of_the_connection, VMax=1)
dom²num_7 = ConstructDomain²(UMin=0, UMax=1, VMin=0, VMax=subtraction_2)
dom²num_8 = ConstructDomain²(UMin=0, UMax=1, VMin=relative_size_of_the_connection, VMax=1)
subsrf_5 = Isotrim(Surface=reparameterize(project_2.Geometry), Domain=dom²num_8)
subsrf_6 = Isotrim(Surface=reparameterize(project_2.Geometry), Domain=dom²num_5)
subsrf_7 = Isotrim(Surface=reparameterize(project.Geometry), Domain=dom²num_6)
subsrf_8 = Isotrim(Surface=reparameterize(project.Geometry), Domain=dom²num_7)
number_slider = Slider(3, range=0..3)
map_srf = MapToSurface(Curve=graft, Source=subsrf, Target=subsrf_5)
map_srf_2 = MapToSurface(Curve=graft_2, Source=subsrf_2, Target=subsrf_6)
rectangle = Rectangle(Plane=rotax.Geometry, XSize=dom, YSize=dom_2, Radius=0)  # -> Rectangle, Length
map_srf_3 = MapToSurface(Curve=graft_3, Source=subsrf_4, Target=subsrf_7)
rectangle_2 = Rectangle(Plane=rotax_2.Geometry, XSize=dom_3, YSize=dom_4, Radius=0)  # -> Rectangle, Length
map_srf_4 = MapToSurface(Curve=graft_4, Source=subsrf_3, Target=subsrf_8)
merge_3 = Merge(Data1=graft, Data2=map_srf)
merge_4 = Merge(Data1=graft_2, Data2=map_srf_2)
merge_5 = Merge(Data1=graft_3, Data2=map_srf_3)
merge_6 = Merge(Data1=graft_4, Data2=map_srf_4)
reverse_surface_direction = ReverseSurfaceDirection(Surface=rectangle.Rectangle, ReverseOption=number_slider)
reverse_surface_direction_2 = ReverseSurfaceDirection(Surface=rectangle_2.Rectangle, ReverseOption=number_slider)
loft = Loft(Curves=merge_4, Options={Adjust=False, Closed=False, LoftEnds=0, LoftSimp=0, LoftType=0, Rebuild=10, Refit=0.01})
loft_2 = Loft(Curves=merge_3, Options={Adjust=False, Closed=False, LoftEnds=0, LoftSimp=0, LoftType=0, Rebuild=10, Refit=0.01})
loft_3 = Loft(Curves=merge_5, Options={Adjust=False, Closed=False, LoftEnds=0, LoftSimp=0, LoftType=0, Rebuild=10, Refit=0.01})
loft_4 = Loft(Curves=merge_6, Options={Adjust=False, Closed=False, LoftEnds=0, LoftSimp=0, LoftType=0, Rebuild=10, Refit=0.01})
clean = CleanTree(RemoveNulls=True, RemoveInvalid=True, RemoveEmpty=False, Tree=loft_2)
clean_2 = CleanTree(RemoveNulls=True, RemoveInvalid=True, RemoveEmpty=False, Tree=loft)
clean_3 = CleanTree(RemoveNulls=True, RemoveInvalid=True, RemoveEmpty=False, Tree=loft_3)
clean_4 = CleanTree(RemoveNulls=True, RemoveInvalid=True, RemoveEmpty=False, Tree=loft_4)
map_to_surface = MapToSurface(Curve=key_stone_pattern, Source=key_stone_pattern_bounding_rectangle, Target=reverse_surface_direction)
map_to_surface_2 = MapToSurface(Curve=key_stone_pattern, Source=key_stone_pattern_bounding_rectangle, Target=reverse_surface_direction_2)
shift = ShiftPaths(Data=clean, Offset=-2)
shift_2 = ShiftPaths(Data=clean_2, Offset=-2)
shift_3 = ShiftPaths(Data=clean_3, Offset=-2)
shift_4 = ShiftPaths(Data=clean_4, Offset=-2)
merge_7 = Merge(Data1=shift, Data2=shift_2)
merge_8 = Merge(Data1=shift_3, Data2=shift_4)
merge_9 = Merge(Data1=mirror_4.Geometry, Data2=map_to_surface, Data3=move_3.Geometry)
merge_10 = Merge(Data1=double_ribbed, Data2=map_to_surface_2, Data3=move_2.Geometry)
loft_5 = Loft(Curves=merge_9, Options={Adjust=False, Closed=False, LoftEnds=0, LoftSimp=0, LoftType=0, Rebuild=10, Refit=0.01})
loft_6 = Loft(Curves=merge_10, Options={Adjust=False, Closed=False, LoftEnds=0, LoftSimp=0, LoftType=0, Rebuild=10, Refit=0.01})
shift_5 = ShiftPaths(Data=loft_5, Offset=-1)
shift_6 = ShiftPaths(Data=loft_6, Offset=-1)
bbx = BrepBrep(BrepA=shift_5, BrepB=shift_6)  # -> Curves, Points
shift_7 = ShiftPaths(Data=merge_7, Offset=-1)
shift_8 = ShiftPaths(Data=merge_8, Offset=-1)
shift_9 = ShiftPaths(Data=bbx.Curves, Offset=-1)
srfsplit = SurfaceSplit(Surface=shift_6, Curves=shift_9)
srfsplit_2 = SurfaceSplit(Surface=shift_5, Curves=shift_9)
join = BrepJoin(Breps=shift_7)  # -> Breps, Closed
join_2 = BrepJoin(Breps=shift_8)  # -> Breps, Closed
area_2 = Area(Geometry=srfsplit_2)  # -> Area, Centroid
area_3 = Area(Geometry=srfsplit)  # -> Area, Centroid
sort = SortList(Keys=area_2.Area, ValuesA=srfsplit_2)  # -> Keys, reverse(ValuesA)
sort_2 = SortList(Keys=area_3.Area, ValuesA=srfsplit)  # -> Keys, reverse(ValuesA)
tstat = TreeStatistics(Tree=join.Breps)  # -> Paths, Length, Count
tstat_2 = TreeStatistics(Tree=join_2.Breps)  # -> Paths, Length, Count
item = ListItem(List=sort.ValuesA, Index=0, Wrap=True)
item_2 = ListItem(List=sort_2.ValuesA, Index=0, Wrap=True)
item_3 = ListItem(List=tstat_2.Paths, Index="-1", Wrap=True)
srf = Surface(item)
srf_2 = Surface(item_2)
merge_11 = Merge(Data1="0", Data2="-1")
merge_12 = Merge(Data1=srf, Data2=srf_2)
branch = TreeBranch(Tree=join_2.Breps, Path=item_3, MaintainPaths=True)
panel = Panel("0")
cull_i = CullIndex(List=tstat.Paths, Indices="-1", Wrap=True)
cull_i_2 = CullIndex(List=tstat_2.Paths, Indices=merge_11, Wrap=True)
prepend_element = PrependElement(Data=branch, Index=tstat_2.Count)
item_4 = ListItem(List=tstat.Paths, Index="-1", Wrap=True)
join_3 = BrepJoin(Breps=merge_12)  # -> Breps, Closed
branch_2 = TreeBranch(Tree=join.Breps, Path=item_4, MaintainPaths=True)
branch_3 = TreeBranch(Tree=join.Breps, Path=cull_i, MaintainPaths=True)
shift_10 = ShiftPaths(Data=prepend_element, Offset=-1)
shift_11 = ShiftPaths(Data=join_3.Breps, Offset=-1)
branch_4 = TreeBranch(Tree=join_2.Breps, Path=cull_i_2, MaintainPaths=True)
join_4 = BrepJoin(Breps=shift_11)  # -> simplify(Breps), Closed
merge_13 = Merge(Data1=branch_2, Data2=branch_4, Data3=shift_10)
merge_14 = Merge(Data1=merge_13, Data2=join_4.Breps)
flatten = FlattenTree(Tree=merge_14, Path="{0}")
join_5 = BrepJoin(Breps=flatten)  # -> Breps, Closed

B = ClusterOutput(join_5.Breps)

# ==== cluster Phase1Vault
span = ClusterInput()
_1st_height_of_the_vaults = ClusterInput()
wall_length = ClusterInput()
_2nd_height_of_the_vaults = ClusterInput()
thickness_of_the_key_stone_kst = ClusterInput()
double_ribbed = ClusterInput()
key_stone_pattern = ClusterInput()
key_stone_b_rec = ClusterInput()

division = Division(A=span, B=2)
pt = ConstructPoint(XCoordinate=division, YCoordinate=0, ZCoordinate=_1st_height_of_the_vaults)
pt_2 = ConstructPoint(XCoordinate=division, YCoordinate=wall_length, ZCoordinate=_2nd_height_of_the_vaults)
ln = Line(StartPoint=pt, EndPoint=pt_2)
midpt = CurveMiddle(Curve=ln)
X = UnitX(Factor=1)
line = LineSDL(Start=midpt, Direction=X, Length=1)
len = Length(Curve=ln)
pl = ConstructPlane(Origin=midpt, XAxis=ln, YAxis=line)
dom = ConstructDomain(DomainStart=expr("-x/2", len), DomainEnd=expr("x/2", len))
dom_2 = ConstructDomain(DomainStart=expr("-x/2", thickness_of_the_key_stone_kst), DomainEnd=expr("x/2", thickness_of_the_key_stone_kst))
rotax = RotateAxis(Geometry=pl, Angle=1.570796327, Axis=ln)  # -> Geometry, Transform
rectangle = Rectangle(Plane=rotax.Geometry, XSize=dom, YSize=dom_2, Radius=0)  # -> Rectangle, Length
reverse_surface_direction = ReverseSurfaceDirection(Surface=rectangle.Rectangle, ReverseOption=Slider(3, range=0..3))
yz = YZPlane(Origin=midpt)
the_extent_of_vertical_extrusion = ClusterInput()
equals = Equality(FirstNumber=the_extent_of_vertical_extrusion, SecondNumber=0)  # -> Equality, Inequality
map_to_surface = MapToSurface(Curve=key_stone_pattern, Source=key_stone_b_rec, Target=reverse_surface_direction)
mirror = Mirror(Geometry=double_ribbed, Plane=yz)  # -> Geometry, Transform
Z = UnitZ(Factor=the_extent_of_vertical_extrusion)
Z_2 = UnitZ(Factor=the_extent_of_vertical_extrusion)
move = Move(Geometry=mirror.Geometry, Motion=Z)  # -> Geometry, Transform
move_2 = Move(Geometry=double_ribbed, Motion=Z_2)  # -> Geometry, Transform
merge = Merge(Data1=move_2.Geometry, Data3=map_to_surface, Data5=move.Geometry)
merge_2 = Merge(Data1=double_ribbed, Data2=move_2.Geometry)
merge_3 = Merge(Data1=mirror.Geometry, Data2=move.Geometry)
loft = Loft(Curves=merge_3, Options={Adjust=False, Closed=False, LoftEnds=0, LoftSimp=0, LoftType=0, Rebuild=10, Refit=0.01})
loft_2 = Loft(Curves=merge_2, Options={Adjust=False, Closed=False, LoftEnds=0, LoftSimp=0, LoftType=0, Rebuild=10, Refit=0.01})
filter = StreamFilter(Gate=equals.Inequality, Stream1=loft)
loft_3 = Loft(Curves=merge, Options={Adjust=False, Closed=False, LoftEnds=0, LoftSimp=0, LoftType=0, Rebuild=10, Refit=0.01})
filter_2 = StreamFilter(Gate=equals.Inequality, Stream1=loft_2)
merge_4 = Merge(Data1=filter_2, Data2=loft_3, Data3=filter)
join = BrepJoin(Breps=merge_4)  # -> Breps, Closed
brep = Brep(join.Breps)
brep_2 = ClusterOutput(brep)

# ==== cluster Phase2Class2
the_vault_of_phase_1 = ClusterInput()
relative_parameter_of_the_mirror_plane = ClusterInput()
angle_of_rotation = ClusterInput()
top_column_clipping_rectangle_width_scal = ClusterInput()
mid_column_height = ClusterInput()
base_column_curve_width_scaler = ClusterInput()
top_bottom_tween_curve_factor = ClusterInput()
top_bottom_tween_curve_width_scaler = ClusterInput()

bbox = BoundingBox(Content=flatten(the_vault_of_phase_1), Plane=PlaneXY(0, 0, 0), UnionBox=True)  # -> Box, Box_2
debrep = DeconstructBrep(Brep=bbox.Box)  # -> Faces, Edges, Vertices
item = ListItem(List=debrep.Faces, Index=0, Wrap=True)  # -> Item, Item1, Item2, Item3, Item4
vec = VectorXYZ(XComponent="0.50", YComponent=relative_parameter_of_the_mirror_plane, ZComponent=0)  # -> Vector, Length
srf = Surface(item.Item4)
evalsrf = EvaluateSurface(Surface=reparameterize(srf), Point=vec.Vector)  # -> Point, Normal, UDirection, VDirection, Frame
yz = YZPlane(Origin=evalsrf.Point)
deplane = DeconstructPlane(Plane=yz)  # -> Origin, XAxis, YAxis, ZAxis
line = LineSDL(Start=deplane.Origin, Direction=deplane.YAxis, Length=1)
neg = Negative(Value=angle_of_rotation)
rotax = RotateAxis(Geometry=yz, Angle=degrees(neg), Axis=line)  # -> Geometry, Transform
mircutpsrf = MirrorCutPolysurface(
    Polysurface=the_vault_of_phase_1,
    MirrorPlane=rotax.Geometry,
    Reach=0,
    Offset=0,
    Flip=False,
    Join=True,
    Keep=False,
    ConnectionType=0,
    Bulge=-0.5)  # -> MirrorCut, SplitIndex, ReachPlane, OffsetPlane, Intersected
debrep_2 = DeconstructBrep(Brep=mircutpsrf.MirrorCut)  # -> Faces, Edges, Vertices
sec = BrepPlane(Brep=mircutpsrf.MirrorCut, Plane=rotax.Geometry)  # -> Curves, Points
brec = BoundingRectangle(Geometry=flatten(sec.Curves), Plane=rotax.Geometry, Axis=0, Slide=0, Union=True)  # -> Bounding, DimensionX, DimensionY
pt = ConstructPoint(XCoordinate=0.5, YCoordinate=0.5, ZCoordinate=0)
srf_2 = Surface(debrep_2.Faces)
iso = IsoCurve(Surface=reparameterize(brec.Bounding), UVPoint=pt)  # -> UIsocurve, VIsocurve
crv = Curve(iso.UIsocurve)
rotax_2 = RotateAxis(Geometry=brec.Bounding, Angle=1.570796327, Axis=crv)  # -> Geometry, Transform
evalsrf_2 = EvaluateSurface(Surface=reparameterize(rotax_2.Geometry), Point=pt)  # -> Point, Normal, UDirection, VDirection, Frame
scale_nu = ScaleNU(Geometry=rotax_2.Geometry, Plane=evalsrf_2.Frame, ScaleX=1, ScaleY=top_column_clipping_rectangle_width_scal, ScaleZ=1)  # -> Geometry, Transform
Z = UnitZ(Factor=mid_column_height)
move = Move(Geometry=scale_nu.Geometry, Motion=Z)  # -> Geometry, Transform
bbx = BrepBrep(BrepA=mircutpsrf.MirrorCut, BrepB=move.Geometry)  # -> Curves, Points
srfsplit = SurfaceSplit(Surface=srf_2, Curves=bbx.Curves)
graft = GraftTree(Tree=bbx.Curves, IncludeEmptyLists=True, IncludeNullItems=True)
project = Project(Geometry=graft, Plane=PlaneXY(0, 0, 0))  # -> Geometry, Transform
area = Area(Geometry=srfsplit)  # -> Area, Centroid
sort = SortList(Keys=area.Area, ValuesA=srfsplit)  # -> Keys, ValuesA
clean = CleanTree(RemoveNulls=True, RemoveInvalid=True, RemoveEmpty=False, Tree=project.Geometry)
item_2 = ListItem(List=reverse(sort.ValuesA), Index=0, Wrap=True)
brec_2 = BoundingRectangle(Geometry=flatten(clean), Plane=evalsrf_2.Frame, Axis=0, Slide=0, Union=True)  # -> Bounding, DimensionX, DimensionY
evalsrf_3 = EvaluateSurface(Surface=reparameterize(brec_2.Bounding), Point=pt)  # -> Point, Normal, UDirection, VDirection, Frame
scale_nu_2 = ScaleNU(Geometry=brec_2.Bounding, Plane=evalsrf_3.Frame, ScaleX=1, ScaleY=base_column_curve_width_scaler, ScaleZ=1)  # -> Geometry, Transform
map_srf = MapToSurface(Curve=project.Geometry, Source=brec_2.Bounding, Target=scale_nu_2.Geometry)
tweencrv = TweenCurve(CurveA=graft, CurveB=map_srf, Factor=top_bottom_tween_curve_factor, BlendType=0)
brec_3 = BoundingRectangle(Geometry=flatten(tweencrv), Plane=evalsrf_3.Frame, Axis=0, Slide=0, Union=True)  # -> Bounding, DimensionX, DimensionY
evalsrf_4 = EvaluateSurface(Surface=reparameterize(brec_3.Bounding), Point=pt)  # -> Point, Normal, UDirection, VDirection, Frame
scale_nu_3 = ScaleNU(Geometry=brec_3.Bounding, Plane=evalsrf_4.Frame, ScaleX=1, ScaleY=top_bottom_tween_curve_width_scaler, ScaleZ=1)  # -> Geometry, Transform
map_srf_2 = MapToSurface(Curve=tweencrv, Source=brec_3.Bounding, Target=scale_nu_3.Geometry)
merge = Merge(Data1=graft, Data2=map_srf_2, Data3=map_srf)
loft = Loft(Curves=merge, Options={Adjust=False, Closed=False, LoftEnds=0, LoftSimp=0, LoftType=0, Rebuild=10, Refit=0.01})
merge_2 = Merge(Data1=item_2, Data2=loft)
join = BrepJoin(Breps=merge_2)  # -> Breps, Closed
flatten = FlattenTree(Tree=join.Breps, Path="{0}")
join_2 = BrepJoin(Breps=flatten)  # -> Breps, Closed

B = ClusterOutput(join_2.Breps)

# ==== cluster Cluster_4
the_number_of_connections_nc = ClusterInput()
span = ClusterInput()
wall_base_thickness = ClusterInput()
wall_length = ClusterInput()
pt = ConstructPoint(XCoordinate=0.5, YCoordinate=0.5, ZCoordinate=0)
relative_parameter_of_the_key_stone_decp = ClusterInput()
_1st_height_of_the_vaults = ClusterInput()
_2nd_height_of_the_vaults_h2 = ClusterInput()
infill_pattern_bounding_rec = ClusterInput()
infill_pattern = ClusterInput()
A = ClusterInput()
key_stone_pattern = ClusterInput()
key_stone_b_rec = ClusterInput()
the_extent_of_vertical_extrusion = ClusterInput()
number_of_infill_layers = ClusterInput()

polygon = Polygon(Plane=PlaneXY(0, 0, 0), Radius=Slider(150, range=0..1000), Segments=the_number_of_connections_nc, FilletRadius=0)  # -> Polygon, Length
area = Area(Geometry=polygon.Polygon)  # -> Area, Centroid
explode = Explode(Curve=polygon.Polygon, Recursive=True)  # -> Segments, Vertices
item = ListItem(List=explode.Segments, Index=0, Wrap=True)
addition = Addition(A=span, B=wall_base_thickness)
end = EndPoints(Curve=item)  # -> Start, End
amp = Amplitude(Vector=item, Amplitude=addition)
pt_2 = Point(end.Start)
move = Move(Geometry=pt_2, Motion=amp)  # -> Geometry, Transform
ln = Line(StartPoint=pt_2, EndPoint=move.Geometry)
len = Length(Curve=ln)
len_2 = Length(Curve=item)
division = Division(A=len, B=len_2)
scale = Scale(Geometry=polygon.Polygon, Center=area.Centroid, Factor=division)  # -> Geometry, Transform
crv = Curve(scale.Geometry)
explode_2 = Explode(Curve=crv, Recursive=True)  # -> Segments, Vertices
midpt = CurveMiddle(Curve=explode_2.Segments)
hframe = HorizontalFrame(Curve=reparameterize(explode_2.Segments), Parameter="0.50")
graft = GraftTree(Tree=hframe, IncludeEmptyLists=True, IncludeNullItems=True)
vec2pt = Vector2Pt(PointA=area.Centroid, PointB=midpt, Unitize=False)  # -> Vector, Length
amp_2 = Amplitude(Vector=vec2pt.Vector, Amplitude=wall_length)
extr = Extrude(Base=explode_2.Segments, Direction=amp_2)
explode_3 = Explode(Curve=extr, Recursive=True)  # -> Segments, Vertices
item_2 = ListItem(List=explode_3.Segments, Index=0, Wrap=True)  # -> Item, Item1, Item2, Item3
crv_2 = Curve(simplify(item_2.Item3))
crv_3 = Curve(simplify(item_2.Item1))
neg = Negative(Value=wall_base_thickness)
offcrv = OffsetCurve(Curve=crv_3, Plane=PlaneXY(0, 0, 0), Distance=neg, BothSides=0, Kinks=0, CapType=1)  # -> simplify(Offset)
offcrv_2 = OffsetCurve(Curve=crv_2, Plane=PlaneXY(0, 0, 0), Distance=neg, BothSides=0, Kinks=0, CapType=1)  # -> simplify(Offset)
srf = Surface(offcrv)
srf_2 = Surface(offcrv_2)
merge = Merge(Data1=srf, Data2=srf_2)
evalsrf = EvaluateSurface(Surface=reparameterize(srf), Point=pt)  # -> Point, Normal, UDirection, VDirection, Frame
evalsrf_2 = EvaluateSurface(Surface=reparameterize(srf_2), Point=pt)  # -> Point, Normal, UDirection, VDirection, Frame
deplane = DeconstructPlane(Plane=evalsrf.Frame)  # -> Origin, XAxis, YAxis, ZAxis
brec = BoundingRectangle(Geometry=merge, Plane=graft, Axis=0, Slide=0, Union=True)  # -> simplify(Bounding), DimensionX, DimensionY
pt_3 = ConstructPoint(XCoordinate=relative_parameter_of_the_key_stone_decp, YCoordinate=0, ZCoordinate=0)
iso = IsoCurve(Surface=reparameterize(brec.Bounding), UVPoint=pt_3)  # -> UIsocurve, VIsocurve
pl = ConstructPlane(Origin=evalsrf.Point, XAxis=deplane.XAxis, YAxis=deplane.ZAxis)
mirror = Mirror(Geometry=evalsrf.Frame, Plane=pl)  # -> Geometry, Transform
crv_4 = Curve(iso.VIsocurve)
end_2 = EndPoints(Curve=crv_4)  # -> Start, End
Z = UnitZ(Factor=_1st_height_of_the_vaults)
Z_2 = UnitZ(Factor=_2nd_height_of_the_vaults_h2)
orient = Orient(Geometry=infill_pattern, Source=infill_pattern_bounding_rec, Target=mirror.Geometry)  # -> Geometry, Transform
orient_2 = Orient(Geometry=infill_pattern, Source=infill_pattern_bounding_rec, Target=evalsrf_2.Frame)  # -> Geometry, Transform
move_2 = Move(Geometry=end_2.Start, Motion=Z_2)  # -> Geometry, Transform
move_3 = Move(Geometry=end_2.End, Motion=Z)  # -> Geometry, Transform
ungroup = Ungroup(Group=orient.Geometry)  # -> simplify(Objects)
ungroup_2 = Ungroup(Group=orient_2.Geometry)  # -> simplify(Objects)
ln_2 = Line(StartPoint=move_2.Geometry, EndPoint=move_3.Geometry)
line = Line(ln_2)
midpt_2 = CurveMiddle(Curve=line)
division_2 = Division(A=A, B=2)
line_2 = LineSDL(Start=midpt_2, Direction=Vector(0, 0, 1), Length=1)
neg_2 = Negative(Value=division_2)
pl_2 = ConstructPlane(Origin=midpt_2, XAxis=line_2, YAxis=line)
offcrv_3 = OffsetCurve(Curve=line, Plane=pl_2, Distance=division_2, BothSides=neg_2, Kinks=0, CapType=1)
reverse_surface_direction = ReverseSurfaceDirection(Surface=offcrv_3, ReverseOption=Slider(3, range=0..3))
vec = VectorXYZ(XComponent=0.5, YComponent=0.5, ZComponent=0)  # -> Vector, Length
evalsrf_3 = EvaluateSurface(Surface=reparameterize(reverse_surface_direction), Point=vec.Vector)  # -> Point, Normal, UDirection, VDirection, Frame
orient_3 = Orient(Geometry=key_stone_pattern, Source=key_stone_b_rec, Target=evalsrf_3.Frame)  # -> Geometry, Transform
equals = Equality(FirstNumber=the_extent_of_vertical_extrusion, SecondNumber=0)  # -> Equality, Inequality
Z_3 = UnitZ(Factor=the_extent_of_vertical_extrusion)
ungroup_3 = Ungroup(Group=orient_3.Geometry)  # -> simplify(Objects)
move_4 = Move(Geometry=ungroup, Motion=Z_3)  # -> Geometry, Transform
move_5 = Move(Geometry=ungroup_2, Motion=Z_3)  # -> Geometry, Transform
merge_2 = Merge(Data1=graft(ungroup), Data2=graft(move_4.Geometry))
merge_3 = Merge(Data1=graft(move_4.Geometry), Data3=graft(ungroup_3), Data5=graft(move_5.Geometry))
merge_4 = Merge(Data1=graft(ungroup_2), Data2=graft(move_5.Geometry))
filter = StreamFilter(Gate=equals.Inequality, Stream1=merge_4)
filter_2 = StreamFilter(Gate=equals.Inequality, Stream1=merge_2)
loft = Loft(Curves=merge_3, Options={Adjust=False, Closed=False, LoftEnds=0, LoftSimp=0, LoftType=0, Rebuild=10, Refit=0.01})
wires = BrepWireframe(Brep=loft, Density=-1)
item_3 = ListItem(List=wires, Index=0, Wrap=True)  # -> simplify(Item), Item1, simplify(Item2)
series = Series(Start=0, Step=1, Count=number_of_infill_layers)
crv_5 = Curve(item_3.Item2)
shift = ShiftPaths(Data=crv_5, Offset=-1)
midpt_3 = CurveMiddle(Curve=shift)
cp = PlaneClosestPoint(Point=midpt_3, Plane=evalsrf.Frame)  # -> Point, UVPoint, Distance
pdecon = Deconstruct(Point=cp.UVPoint)  # -> XComponent, YComponent, ZComponent
sort = SortList(Keys=pdecon.YComponent, ValuesA=shift)  # -> Keys, ValuesA
item_4 = ListItem(List=sort.ValuesA, Index=series, Wrap=True)  # -> simplify(Item)

C = ClusterOutput(area.Centroid)
T = ClusterOutput(graft)
inequality = ClusterOutput(equals.Inequality)

loft_2 = Loft(Curves=filter, Options={Adjust=False, Closed=False, LoftEnds=0, LoftSimp=0, LoftType=0, Rebuild=10, Refit=0.01})
loft_3 = Loft(Curves=filter_2, Options={Adjust=False, Closed=False, LoftEnds=0, LoftSimp=0, LoftType=0, Rebuild=10, Refit=0.01})

merge_5 = Merge(Data1=loft_3, Data2=loft, Data3=loft_2)
join = BrepJoin(Breps=merge_5)  # -> Breps, Closed

B = ClusterOutput(join.Breps)
crv_6 = Curve(item_4)
crv_7 = ClusterOutput(crv_6)

# ==== cluster Cluster_5
threshold_curves = ClusterInput()
xy = XYPlane(Origin=Point(0, 0, 0))
auxilary_profile_2_relative_placement = ClusterInput()
auxilary_profile_1_relative_placement = ClusterInput()

end = EndPoints(Curve=threshold_curves)  # -> Start, End
pt = Point(end.Start)
cp = PlaneClosestPoint(Point=pt, Plane=xy)  # -> Point, UVPoint, Distance
sort = SortList(Keys=cp.UVPoint, ValuesA=threshold_curves)  # -> Keys, ValuesA
crv = Curve(sort.ValuesA)
flip = FlipMatrix(Data=crv)  # -> reverse(Data)
lng = ListLength(List=flip)
series = Series(Start=0, Step=1, Count=lng)
shift = ShiftList(List=flip, Shift=series, Wrap=invert(False))
item = ListItem(List=shift, Index=0, Wrap=True)  # -> Item, Item1
subtraction = Subtraction(A=1, B=auxilary_profile_2_relative_placement)
subtraction_2 = Subtraction(A=1, B=auxilary_profile_1_relative_placement)
subtraction_3 = Subtraction(A="1", B=subtraction)
end_2 = EndPoints(Curve=item.Item)  # -> Start, End
x_tremez = Extremes(Curve=item.Item1, Plane=PlaneXY(0, 0, 0))  # -> Highest, Lowest
subtraction_4 = Subtraction(A="1", B=subtraction_2)
end_3 = EndPoints(Curve=item.Item1)  # -> Start, End
x_tremez_2 = Extremes(Curve=item.Item, Plane=PlaneXY(0, 0, 0))  # -> Highest, Lowest
pt_2 = Point(x_tremez_2.Highest)
pt_3 = Point(end_2.End)
pt_4 = Point(end_3.Start)
pt_5 = Point(x_tremez.Highest)
eval = EvaluateCurve(Curve=reparameterize(item.Item), Parameter=subtraction)  # -> Point, Tangent, Angle
eval_2 = EvaluateCurve(Curve=reparameterize(item.Item), Parameter=subtraction_2)  # -> Point, Tangent, Angle
eval_3 = EvaluateCurve(Curve=reparameterize(item.Item1), Parameter=subtraction_3)  # -> Point, Tangent, Angle
eval_4 = EvaluateCurve(Curve=reparameterize(item.Item1), Parameter=subtraction_4)  # -> Point, Tangent, Angle
ln = Line(StartPoint=eval_2.Point, EndPoint=eval_4.Point)
ln_2 = Line(StartPoint=pt_2, EndPoint=pt_5)
ln_3 = Line(StartPoint=eval.Point, EndPoint=eval_3.Point)
ln_4 = Line(StartPoint=pt_3, EndPoint=pt_4)

relay = ClusterOutput(item.Item1)
relay_2 = ClusterOutput(item.Item)
L = ClusterOutput(ln)
L_2 = ClusterOutput(ln_2)
L_3 = ClusterOutput(ln_3)
L_4 = ClusterOutput(ln_4)

# ==== cluster Cluster_6
C = ClusterInput()
centroid = ClusterInput()
general_amplitude = ClusterInput()
even_outermost_vector_amplitude_eova = ClusterInput()
innermost_vector_amplitude_iva = ClusterInput()
odd_outermost_vector_amplitude_oova = ClusterInput()
G = ClusterInput()

item = ListItem(List=C, Index=0, Wrap=True)  # -> Item1, Item
midpt = CurveMiddle(Curve=C)
amp = Amplitude(Vector=C, Amplitude=1)
end = EndPoints(Curve=C)  # -> Start, End
merge = Merge(Data1=item.Item, Data2=item.Item1)
pt = Point(simplify(end.Start))
pt_2 = Point(simplify(end.End))
vec2pt = Vector2Pt(PointA=midpt, PointB=centroid, Unitize=False)  # -> Vector, Length
loft = Loft(Curves=merge, Options={Adjust=False, Closed=False, LoftEnds=0, LoftSimp=0, LoftType=0, Rebuild=10, Refit=0.01})
project = Project(Geometry=vec2pt.Vector, Plane=loft)  # -> Geometry, Transform
neg = Negative(Value=amp)
merge_2 = Merge(Data1=graft(amp), Data2=graft(neg))  # -> simplify(Result)
move = Move(Geometry=pt_2, Motion=expr("-x", amp))  # -> simplify(Geometry), Transform
move_2 = Move(Geometry=pt, Motion=amp)  # -> simplify(Geometry), Transform
amp_2 = Amplitude(Vector=project.Geometry, Amplitude=general_amplitude)
panel = Panel("""1
0""")
dispatch = Dispatch(List=amp_2, DispatchPattern=panel)  # -> ListA, ListB
neg_2 = Negative(Value=dispatch.ListB)
weave = Weave(Pattern=reverse(panel), Stream0=dispatch.ListA, Stream1=neg_2, NullGaps=False)
lastdex = LastIndex(List=weave)
item_2 = ListItem(List=weave, Index=lastdex, Wrap=True)
item_3 = ListItem(List=weave, Index="0", Wrap=True)
amp_3 = Amplitude(Vector=item_2, Amplitude=even_outermost_vector_amplitude_eova)
multiplication = Multiplication(A=item_3, B=Slider(1, range=0..10))
amp_4 = Amplitude(Vector=item_3, Amplitude=innermost_vector_amplitude_iva)
multiplication_2 = Multiplication(A=item_2, B=Slider(1, range=0..10))
merge_3 = Merge(Data1=amp_4, Data2=amp_3)
ins = InsertItems(List=lastdex, Item="0", Indices="0", Wrap=True)
replace = ReplaceItems(List=weave, Item=merge_3, Indices=ins, Wrap=False)
lastdex_2 = LastIndex(List=replace)
item_4 = ListItem(List=replace, Index=expr("x-1", lastdex_2), Wrap=True)
multiplication_3 = Multiplication(A=item_4, B=odd_outermost_vector_amplitude_oova)
amp_5 = Amplitude(Vector=item_4, Amplitude=odd_outermost_vector_amplitude_oova)
replace_2 = ReplaceItems(List=replace, Item=amp_5, Indices=expr("x-1", lastdex_2), Wrap=False)
filter = StreamFilter(Gate=G, Stream0=replace, Stream1=replace_2)
move_3 = Move(Geometry=midpt, Motion=filter)  # -> Geometry, Transform
move_4 = Move(Geometry=graft(move_3.Geometry), Motion=merge_2)  # -> reverse(simplify(Geometry)), Transform
ins_2 = InsertItems(List=move_4.Geometry, Item=graft(move_3.Geometry), Indices=1, Wrap=True)  # -> simplify(List)
pt_3 = Point(ins_2)
merge_4 = Merge(Data1=graft(pt), Data2=graft(move_2.Geometry), Data3=pt_3, Data4=graft(move.Geometry), Data5=graft(pt_2))
nurbs = NurbsCurve(Vertices=merge_4, Degree=3, Periodic=False)  # -> Curve, Length, Domain

C_2 = ClusterOutput(nurbs.Curve)

# ==== cluster DomeRiser
d1 = ClusterInput()
d2 = ClusterInput()
C = ClusterInput()
dome_rise = ClusterInput()

merge = Merge(Data1=d1, Data2=d2)  # -> simplify(Result)
simplify = SimplifyTree(Tree=merge, Front=False)
item = ListItem(List=simplify, Index=1, Wrap=True)
midpt = CurveMiddle(Curve=C)
shift = ShiftPaths(Data=item, Offset=-1)
shift_2 = ShiftPaths(Data=midpt, Offset=-1)
flip = FlipMatrix(Data=shift)
item_2 = ListItem(List=reverse(flip), Index=0, Wrap=True)
avr = Average(Input=shift_2)
shift_3 = ShiftPaths(Data=item_2, Offset=-1)
flatten = FlattenTree(Tree=avr, Path="{0}")
end = EndPoints(Curve=shift_3)  # -> Start, End
join = JoinCurves(Curves=shift_3, Preserve=False)
area = Area(Geometry=join)  # -> Area, Centroid
pt = Point(end.Start)
ln = Line(StartPoint=pt, EndPoint=area.Centroid)
project = Project(Geometry=ln, Plane=PlaneXY(0, 0, 0))  # -> Geometry, Transform
weave = Weave(Pattern=[0, 1], Stream0=ln, Stream1=project.Geometry, NullGaps=False)
vec2pt = Vector2Pt(PointA=flatten, PointB=area.Centroid, Unitize=False)  # -> Vector, Length
partition = PartitionList(List=weave, Size=2)
loft = Loft(Curves=partition, Options={Adjust=False, Closed=False, LoftEnds=0, LoftSimp=0, LoftType=0, Rebuild=10, Refit=0.01})
flatten_2 = FlattenTree(Tree=loft, Path="{0}")
bbox = BoundingBox(Content=flatten_2, Plane=PlaneXY(0, 0, 0))  # -> Box, Box_2
debox = DeconstructBox(Box=bbox.Box)  # -> Plane, X, Y, graft(Z)
Z = UnitZ(Factor=expr("x/2", debox.Z))
move = Move(Geometry=loft, Motion=Z)  # -> Geometry, Transform
shift_4 = ShiftPaths(Data=move.Geometry, Offset=-1)
shift_5 = ShiftList(List=shift_4, Shift=1, Wrap=True)
pdecon = Deconstruct(Point=vec2pt.Vector)  # -> XComponent, YComponent, ZComponent
weave_2 = Weave(Pattern=[0, 1], Stream0=shift_4, Stream1=shift_5, NullGaps=False)
partition_2 = PartitionList(List=weave_2, Size=2)  # -> simplify(Chunks)
vec = VectorXYZ(XComponent=pdecon.XComponent, YComponent=pdecon.YComponent, ZComponent=0)  # -> Vector, Length
shift_6 = ShiftPaths(Data=C, Offset=-1)
graft = GraftTree(Tree=vec.Vector, IncludeEmptyLists=True, IncludeNullItems=True)
join_2 = BrepJoin(Breps=partition_2)  # -> Breps, Closed
project_2 = Project(Curve=shift_6, Brep=join_2.Breps, Direction=simplify(graft))
disc = Discontinuity(Curve=project_2, Level=1)  # -> Points, Parameters
item_3 = ListItem(List=disc.Points, Index=0, Wrap=True)  # -> Item, Item1, Item2
Z_2 = UnitZ(Factor=dome_rise)
move_2 = Move(Geometry=item_3.Item1, Motion=Z_2)  # -> Geometry, Transform
merge_2 = Merge(Data1=item_3.Item, Data2=move_2.Geometry, Data3=item_3.Item2)
pline = PolyLine(Vertices=merge_2, Closed=False)  # -> simplify(Polyline)

pl = ClusterOutput(pline)
